# Grasshopper definition MoreRotTest.gh (Grasshopper 0.9.76)

xy = XYPlane(Origin=Point(0, 0, 0))
yz = YZPlane(Origin=Point(0, 0, 0))
xy_2 = XYPlane(Origin=Point(0, 0, 0))
rotate = Rotate(Geometry=xy, Angle=0.7853981634, Plane=yz)  # -> Geometry, Transform
rotate_2 = Rotate(Angle=0.7853981634, Plane=xy_2)  # -> Geometry, Transform
comp = Compound(Transforms=[rotate_2.Transform, rotate.Transform])
rotate_3 = Rotate(Angle=0.7853981634, Plane=rotate.Geometry)  # -> Geometry, Transform
matrix = TransformMatrix(comp, Digits=3)
matrix_2 = TransformMatrix(rotate_3.Transform, Digits=3)
