# Grasshopper definition RotationTest.gh (Grasshopper 0.9.76)

brep = Brep(<brep referenced from the Rhino model>)
bbox = BoundingBox(Content=brep, Plane=PlaneXY(0, 0, 0))  # -> Box, Box_2
boxprop = BoxProperties(Box=bbox.Box)  # -> Center, Diagonal, Area, Volume, Degeneracy
X = UnitX(Factor=1)
pl = PlaneNormal(Origin=boxprop.Center, ZAxis=X)
pt = ConstructPoint(XCoordinate=0, YCoordinate=0, ZCoordinate=0)
vec = VectorXYZ(XComponent=2, YComponent=10, ZComponent=0)  # -> Vector, Length
rotate = Rotate(Geometry=brep, Angle=Slider(1.791, range=0..3.141), Plane=pl)  # -> Geometry, Transform
move = Move(Geometry=brep, Motion=vec.Vector)  # -> Geometry, Transform
transform = Transform(Geometry=pt, Transform=move.Transform)
move_2 = Move(Geometry=brep, Motion=expr("-X", transform))  # -> Geometry, Transform
comp = Compound(Transforms=flatten(move.Transform))
c_script = CSharpScript(x=rotate.Transform, y=move_2.Transform)  # -> out, A; inputs x: Transform, y: Transform
# ---------- c_script: C# ----------
    A = Transform.Multiply(y, x);
# ---------- end c_script ----------
transform_2 = Transform(c_script.A)
matrix = TransformMatrix(comp, Digits=3)
